# Grasshopper definition auto_entourage_example_practical_finish.gh (Grasshopper 1.0.7)
# plug-ins: ImgCrop

crv = Curve(Tree({0;0}: [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], {0;1}: [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], {0;2}: [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], {0;3}: [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]))

# ---- group: stree model
# Auto Entourage Demo
# Author: Vincent Mai
# Version: 0.5.0
# EX05
mesh = Mesh([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])
crv_2 = Curve([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])
geo = Geometry(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)
geo_2 = Geometry([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])

# ----
pt = Point([Point(-35, 63, 0.5048929148), Point(-36, 27, 0.5048929148), Point(-35.57160952, -8.961601135, 0.5048929148), Point(-29.26038457, -44.84589349, 0.5048929148), Point(-29.00713106, -80.25917528, 0.5048929148), Point(35.69913948, -44.67705782, 0.5048929148), Point(35.61472164, -9.010522522, 0.5048929148), Point(35.31925922, 27.24693762, 0.5048929148), Point(35.82576623, 63.20893534, 0.5048929148)])
# Landscape Planting
# Visualization
# EX06
pt_2 = Point([Point(0, 3, 0.5048929148), Point(0, 25, 0.5048929148), Point(0, 51, 0.5048929148), Point(0, 77, 0.5048929148)])
boundary = BoundarySurfaces(Edges=crv)
panel = Panel("""20
15
10
5""")
entwine = Entwine(Branch00=pt, Branch01=pt_2, FlattenInputs=True)
# Urban Street
# Visualization
crv_3 = Curve([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])
popgeo = PopulateGeometry(Geometry=boundary, Count=graft(panel), Seed=1)
path = ConstructPath(Indices=Slider(0, range=0..3))
panel_2 = Panel("""20 To 30
25 to 35""")
boundary_2 = BoundarySurfaces(Edges=crv_3)
lng = ListLength(List=entwine)
panel_3 = Panel("""10_30
30_40
40_60
60_90""")
path_2 = FilePath("C:\Users\Vincent Mai\Desktop\entourage\processed\trees_groups\")
trim = TrimTree(Tree=popgeo, Depth=1)
branch = TreeBranch(Tree=simplify(crv), Path=path, MaintainPaths=True)
popgeo_2 = PopulateGeometry(Geometry=boundary_2, Count="50", Seed=1)
random = Random(Range=graft(panel_2), Number=lng, Seed=2)
panel_4 = Panel(path_2)
concat = Concatenate(FragmentA=path_2, FragmentB=panel_3)
rep = ReplaceText(Text=panel_3, Find="_", Replace=" to ", RecursiveReplace=False)
lng_2 = ListLength(List=trim)
path_3 = FilePath("C:\Users\Vincent Mai\Desktop\entourage\processed\trees\")
button = Button()
button_2 = Button()
random_2 = Random(Range=graft(rep), Number=lng_2, Seed=2)
path_4 = FilePath("C:\Users\Vincent Mai\Desktop\entourage\processed\people\")
panel_5 = Panel("""0
1""")
concat_2 = Concatenate(FragmentA=concat, FragmentB="\")  # -> graft(Result)
ae = AutoEntourage(
    Path=path_4,
    ImgHeight="5.7",
    Point=popgeo_2,
    LayerName="entourage_people",
    Seed=graft(panel_5),
    Load=button,
    Orient=button_2)
ae_2 = AutoEntourage(Path=path_3, ImgHeight=random, Point=entwine, LayerName="entourage_trees", Load=button, Orient=button_2)
ae_3 = AutoEntourage(Path=concat_2, ImgHeight=random_2, Point=trim, Load=Button(), Orient=Button())
panel_6 = Panel(concat_2)
