# Grasshopper definition auto_entourage_example_toy_finish.gh (Grasshopper 1.0.7)
# plug-ins: LunchBox, ImgCrop

pt = Point([Point(53.05141526, -65.67379145, 0), Point(61.22684585, -51.07546445, 0), Point(-65.66115208, -28.91739529, 0), Point(-21.49589585, 94.03207222, 0), Point(-6.471876625, 89.38175678, 0), Point(-64.55313561, -68.2348104, 0)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])
# EX04
srf = Surface(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)
# Auto Entourage Demo
# Author: Vincent Mai
# Version: 0.5.0
# EX00
path = FilePath("C:\Users\Vincent Mai\Desktop\entourage\raw\people\")
path_2 = FilePath("C:\Users\Vincent Mai\Desktop\entourage\processed\people\")
popgeo = PopulateGeometry(Geometry=srf, Count="200", Seed=1)
# EX02
panel = Panel("20 To 30")
lng = ListLength(List=pt)
# Cropping Entourages
# (run once only)
crop = ImgCrop(path=path, out=path_2, crop=Button())
# Points as Input
# Varying Heights
random = Random(Range=panel, Number=lng, Seed=2)
randomsplit = RandomSplitList(MasterList=popgeo, Seed=2, Split="0.2")  # -> ListA, ListB
panel_2 = Panel(crop)
entwine = Entwine(Branch00=randomsplit.ListA, Branch01=randomsplit.ListB, FlattenInputs=True)
path_3 = FilePath("C:\Users\Vincent Mai\Desktop\entourage\processed\trees\")
# Working with
# GH Trees
panel_3 = Panel("20 To 30")
lng_2 = ListLength(List=randomsplit.ListA)
ae = AutoEntourage(Path=path_3, ImgHeight=random, Point=pt, LayerName="my_entourage", Load=Button(), Orient=Button())
random_2 = Random(Range=panel_3, Number=lng_2, Seed=2)
entwine_2 = Entwine(Branch00=random_2, Branch01="5.7", FlattenInputs=True)
path_4 = FilePath("C:\Users\Vincent Mai\Desktop\entourage\processed\trees\")
path_5 = FilePath("C:\Users\Vincent Mai\Desktop\entourage\processed\people\")
ae_2 = AutoEntourage(
    Path=graft([path_4, path_5]),
    ImgHeight=entwine_2,
    Point=entwine,
    LayerName="my_entourage",
    Load=Button(),
    Orient=Button())
# EX03
crv = Curve([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])
# EX01
path_6 = FilePath("C:\Users\Vincent Mai\Desktop\entourage\processed\people\")
pt_2 = Point([Point(-50.26628317, -77.85120456, 0), Point(99.57821025, 75.1643028, 0), Point(-83.39608143, 85.19530761, 0), Point(89.9258201, -69.94086065, 0), Point(-8.024339801, 24.5006641, 0), Point(20.50666358, 97.22242486, 0)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])
# Regions as Input
# Varying Numbers
boundary = BoundarySurfaces(Edges=crv)
area = Area(Geometry=crv)  # -> Area, Centroid
lng_3 = ListLength(List=area.Area)
# Points as Input
# Uniform Height
ae_3 = AutoEntourage(Path=path_6, ImgHeight="5.7", Point=pt_2, Load=Button(), Orient=Button())
subtraction = Subtraction(A=lng_3, B="1")
multiplication = Multiplication(A=area.Area, B="0.001")
dom = ConstructDomain(DomainStart=0, DomainEnd=subtraction)
int = Integer(multiplication)
range = Range(Domain=dom, Steps=subtraction)  # -> simplify(graft(Range))
popgeo_2 = PopulateGeometry(Geometry=boundary, Count=int, Seed=1)  # -> simplify(Population)
path_7 = FilePath("C:\Users\Vincent Mai\Desktop\entourage\processed\people\")
ae_4 = AutoEntourage(Path=path_7, ImgHeight="5.7", Point=popgeo_2, LayerName="my_entourage", Seed=range, Load=Button(), Orient=Button())
