# Grasshopper definition auto_entourage_example_toy_start.gh (Grasshopper 1.0.7)
# plug-ins: ImgCrop

# EX04
srf = Surface(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)
# Auto Entourage Demo
# Author: Vincent Mai
# Version: 0.5.0
# EX00
# Points as Input
# Varying Heights
# EX02
pt = Point([Point(53.05141526, -65.67379145, 0), Point(61.22684585, -51.07546445, 0), Point(-65.66115208, -28.91739529, 0), Point(-21.49589585, 94.03207222, 0), Point(-6.471876625, 89.38175678, 0), Point(-64.55313561, -68.2348104, 0)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])
popgeo = PopulateGeometry(Geometry=srf, Count="200", Seed=1)
# Working with
# GH Trees
panel = Panel("20 To 30")
lng = ListLength(List=popgeo)
random = Random(Range=panel, Number=lng, Seed=2)
path = FilePath("C:\Users\Vincent Mai\Desktop\entourage\processed\trees\")
ae = AutoEntourage(Path=graft(path), ImgHeight=random, Point=popgeo, LayerName="trees_and_people", Load=Button(), Orient=Button())
# Cropping Entourages
# (run once only)
# Points as Input
# Uniform Height
# EX01
pt_2 = Point([Point(-3.93219446, 38.39207563, 0), Point(-32.07958882, -34.19092667, 0), Point(15.51431167, -44.25964041, 0), Point(10.629388, 0.5409994165, 0), Point(-49.81847166, 4.121415412, 0), Point(11.90512721, -19.00201296, 0)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])
# Regions as Input
# Varying Numbers
# EX03
crv = Curve([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])
