# Grasshopper definition auto_entourage.gh (Grasshopper 1.0.7)
# plug-ins: Python

path = FilePath("C:\Users\Vincent Mai\Desktop\Projects\speranza_architecture\auto_entourage\examples\entourages\trees\trimmed\")
path_2 = FilePath("C:\Users\Vincent Mai\Desktop\Projects\speranza_architecture\auto_entourage\examples\entourages\trees\")
letters = Curve([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])
qcrop = QuickCrop(in_path=path_2, out_path=path, crop=Toggle(False))
dom = ConstructDomain(DomainStart=15, DomainEnd=25)
panel = Panel(qcrop)
random = Random(Range=dom, Number="90", Seed=2)
square = Curve(<curve referenced from the Rhino model>)

# ---- group: Point Attractor
number_slider = Slider(9, range=0..25)
len = Length(Curve=square)
md_slider = MDSlider(
    SliderMode=0,
    slider_value=Point(0.467057577, 0.2693206043, 0.5),
    x_domain=Domain(-50, 50),
    y_domain=Domain(-50, 50),
    z_domain=Domain(0, 1))
division = Division(A=len, B=4)
division_2 = Division(A=division, B=number_slider)
xy = XYPlane(Origin=Point(-50, -50, 0))
recgrid = Rectangular(Plane=xy, SizeX=division_2, SizeY=division_2, ExtentX=number_slider, ExtentY=number_slider)  # -> simplify(Cells), Points
rec = Rectangle(simplify(recgrid.Cells))
pt = ConstructPoint(XCoordinate=0, YCoordinate=0, ZCoordinate=0)
pcen = PolygonCenter(Polyline=rec)  # -> CenterV, CenterE, CenterA
move = Move(Geometry=pt, Motion=md_slider)  # -> Geometry, Transform
dist = Distance(PointA=move.Geometry, PointB=pcen.CenterV)
sqr = Square(Value=dist)  # disabled
ma = MassAddition(Input=flatten(sqr))  # -> Result, PartialResults; disabled
division_3 = Division(A=sqr, B=ma.Result)  # disabled
multiplication = Multiplication(A="90", B=division_3)  # disabled
int = Integer(multiplication)  # disabled
pop2d = Populate2D(Region=rec, Count=int, Seed=1)  # -> flatten(Population); disabled

# ----
panel_2 = Panel("4")
aut_ent = AutoEntourage(path=path, img_height=random, region=square, num="90", layer_name="entourage_01", place=Toggle(False))
