# Grasshopper definition auto_entourage_dev.gh (Grasshopper 1.0.7)

number_slider = Slider(0, range=0..10)
panel = Panel("""1 To 5
5 To 10
10 To 20""")
button = Button()
code = FilePath("C:\Users\Vincent Mai\Desktop\Projects\speranza_architecture\auto_entourage\src\auto_entourage.py")
pt = Point([<point referenced from the Rhino model> x3])
pt_2 = Point(<point referenced from the Rhino model>)
panel_2 = Panel("""5
10""")
entwine = Entwine(Branch00=pt, Branch01=pt_2, FlattenInputs=True)
file = ReadFile(File=code, PerLineParse=False)
panel_3 = Panel("""40
20
10""")
crv = Curve(graft([<curve referenced from the Rhino model> x3]))
data = Data(graft(panel_3))
random = Random(Range=graft(panel), Number=data, Seed=2)
data_2 = Data(graft(panel_2))
path = FilePath("C:\Users\Vincent Mai\Desktop\trimmed_entourage\")
data_3 = Data(random)
data_4 = Data(entwine)
python = GhPythonScript(Code=file, Path=path, Img_height=data_2, Point=data_4, Seed=number_slider, Place=button)
python_2 = GhPythonScript(Code=file, Path=path, Img_height=data_3, Region=crv, Num=data, Layer_name="my_layer", Seed=number_slider, Place=button)
python_3 = GhPythonScript(x=data_4)  # -> out, a; inputs x: tree
# ---------- python_3: Python ----------
__author__ = "Vincent Mai"
__version__ = "2020.10.17"

import rhinoscriptsyntax as rs
from Grasshopper import DataTree

print(isinstance(x, DataTree[object]))
# ---------- end python_3 ----------
panel_4 = Panel(python_2)
python_4 = GhPythonScript()  # inputs region: Curve, num: Int32, point: Point3d, place: Boolean
# ---------- python_4: Python ----------
"""Populates a given region (or ahcnor points) with entourages
    Inputs:
        path: File path to the image folder.
        img_height: The entourage height in the model.
        region: A region delineated by a closed curve.
        num: The number of entourages within the region.
        point: (Optional) The points where the entourage is anchored.
        layer_name: Default to "Entourages" if not speficied.
        place: If true, loads entourages in a new layer; if false, deletes entourages and the new layer.
"""
__author__ = "Vincent Mai"
__version__ = "0.1.0"

from ghpythonlib.componentbase import executingcomponent as component
import Grasshopper, GhPython
import System
import Rhino
import rhinoscriptsyntax as rs
import scriptcontext as sc
import Rhino.Geometry as rg
import Rhino.RhinoDoc
import ghpythonlib.components as ghc
import Grasshopper.Kernel as ghk
import random
import math
import os
import inspect

class AutoEntourage(component):
    
    def RunScript(self, path, img_height, region, num, point, layer_name, place):
                
        RANDOM_SEED = 0
        ghdoc = sc.doc
        
        if not layer_name: 
            layer_name = "Entourages"
        
        def rhinoDocContext(func):
            """Decorator to switch ghdoc context to rhinodoc
            """
            def wrapper(*args, **kwargs):
                sc.doc = Rhino.RhinoDoc.ActiveDoc
                func(*args, **kwargs)
                sc.doc = ghdoc
            return wrapper
        
        @rhinoDocContext
        def addPictureFrame(path, point, normal, width, height):
            """Calls rhinoscriptsyntax's method of addPictureFrame and centers the
            picture around the given point
            """
            centering_vector = rs.VectorRotate(normal, 90, [0, 0, 1])
            point -= 0.5*centering_vector*width
            x_axis = rs.VectorRotate(normal, 90, [0, 0, 1])
            y_axis = rg.Vector3d(0, 0, 1)
            plane = rg.Plane(point, x_axis, y_axis)
            sc.doc.ActiveDoc.Objects.AddPictureFrame(plane, path, False, width,
                                                     height, False, False)
            
        def getFiles(path):
            """Returns a list of paths to PNGs from a directory
            """
            fileList = os.listdir(path)
            return [path + file for file in fileList if file.endswith(".png")]
        
        def getImageSize(path):
            """Returns the height and width of the image from the file path
            """
            bmp = System.Drawing.Bitmap.FromFile(path)
            return (bmp.Width, bmp.Height)
        
        def scaleImage(baseWidth, baseHeight, targetHeight):
            """scales image by the target height
            """
            factor = targetHeight / baseHeight
            return baseWidth*factor, targetHeight
            
        def getCameraDirection():
            """Returns the camera direction of the active viewport
            """
            cameraDir = sc.doc.Views.ActiveView.ActiveViewport.CameraDirection
            projCameraDir = rg.Vector3d(cameraDir.X, cameraDir.Y, 0)
            projCameraDir.Unitize()
            return projCameraDir
        
        def populateRegion(region, num):
            """Returns a list of populated points given a region
            """
            brep = rg.Brep.CreatePlanarBreps(region)
            return ghc.PopulateGeometry(brep, num, seed=RANDOM_SEED)
        
        def placeImage(imgList, ptsList, normal):
            """Places images given an list of anchor points and normal vector
            """
            for idx, pt in enumerate(ptsList):
                img = imgList[idx % len(imgList)]
                try:
                    width, height = scaleImage(*getImageSize(img),
                                               targetHeight=img_height)
                    addPictureFrame(img, pt, normal, width, height)
                except:
                    print("Failed to process {}".format(img))
                    
        def inNewLayer(layer_name):
            """Decorator to call a function in a newly created layer
            """
            def wrap_func(func):
                def wrapper(*args, **kwargs):
                    createAndSetCurrentLayer(layer_name)
                    func(*args, **kwargs)
                    resetLayer()
                return wrapper
            return wrap_func
        
        @inNewLayer(layer_name)
        def populate(path, region, point, num):
            """Populate a region (closed curve) with vertical picture frames
            """
            imgList = getFiles(path)
            imgList = random.sample(imgList, len(imgList))
            cameraDirection = getCameraDirection()
            if region:
                ptsList = populateRegion(region, num)
                placeImage(imgList, ptsList, cameraDirection)
            if point:
                placeImage(imgList, [point], cameraDirection)
                
        
        @rhinoDocContext
        def createAndSetCurrentLayer(layer_name):
            """Creates a layer with the given name
            """
            layer = sc.doc.Layers.FindName(layer_name)
            if layer is None:
                layer_idx = sc.doc.Layers.Add(layer_name, System.Drawing.Color.Black)
            else:
                layer_idx = layer.Index
            sc.doc.Layers.SetCurrentLayerIndex(layer_idx, True)
        
        @rhinoDocContext
        def resetLayer():
            """Resets layer to default layer
            """
            sc.doc.Layers.SetCurrentLayerIndex(0, True)
        
        @rhinoDocContext
        def deleteLayer(layer_name):
            """Deletes a layer by its name as well as all objects inside
            """
            rhinoObjects = sc.doc.Objects.FindByLayer(layer_name)
            if rhinoObjects:
                for obj in rhinoObjects:
                    sc.doc.Objects.Delete(obj)
            sc.doc.Layers.SetCurrentLayerIndex(0, True)
            sc.doc.Layers.Delete(sc.doc.Layers.FindName(layer_name), True)
        
        def get_warning_message():
            """Returns warning messages or None if no warnings found
            """
            message = None
            if not path:
                message = "Path to PNGs is missing"
            elif not img_height:
                message = "img_height is missing"
            elif not point and not region:
                message = "At least one region or one point is needed"
            if region and not num:
                message = "Need to specify num (of entourages) in region"
            return message
        
        def get_error_message():
            """Returns error messages or None if no errors found
            """
            message = None
            if region and point:
                message = "choose region or point but not both"
            return message
        
        def display_warnings():
            warning_message = get_warning_message()
            if warning_message is not None:
                w = ghk.GH_RuntimeMessageLevel.Warning
                self.AddRuntimeMessage(w, warning_message)
        
        def display_errors():
            error_message = get_error_message()
            if error_message is not None:
                e = ghk.GH_RuntimeMessageLevel.Error
                self.AddRuntimeMessage(e, error_message)

        display_warnings()
        display_errors()
        
        if place:
            populate(path, region, point, num)
        else:
            deleteLayer(layer_name)
# ---------- end python_4 ----------
